# Grasshopper definition HopsMasterSheet.gh (Grasshopper 1.0.7)
# plug-ins: LunchBox, Human, Hops

# Beskrivelse: OC Engineering Grasshopper Template.
# Grafisk standard ses herunder.
# Højre klik på farve og sæt den til standard, grupper herefter og sæt kommentarer på gruppen.
# 
# 
# BESKRIVELSE AF SCRIPT:
# Script der bruges i hops, oploades til GitHub så der er mulighed for at dele hops med flere brugere, da der bruges et link af http.... typen, hvormed den ikke er bruger bestemt i form af en specifik sti.
# 
# TEORI:
# bla bla.
# 
# INPUT:
# bla bla.
# 
# OUTPUT:
# bla bla.
gældende_udgivelsesdato_og_version = Panel("15.03.2023 - 01.00.00.00")
# Output
# Input
# data
# geometry
# preview
# OBS
# big group
revisions_historik = Panel("15.03.2023 - 01.00.00.00 - første udgivelse")
udviklet_af = Panel("Daniel Bo Olesen")
projekt = Panel("SagsNr - SagsNavn")
tilføjelser_ændringer_der_kan_implemente = Panel("- Indbyg udbøjning formel")  # "Tilføjelser ændringer der kan implementeres"
# SETUP: DEVELOP AND MAINTAIN HOPS FUNCTIONS
# ----------------------------------
# Hops functions are uploaded to github repository.
# 
# Repository is cloned to local computer, this is your working folder. Use Github desktop app to commit changes etc. If pointed to a sharepoint folder or similar, your collegues etc. automaticly gets new changes without worrying about .git.
# ____________________________________
# 
# 
# USE THE HOPS FUNCTIONS, SHARED FUNCTIONS
# -------------------------------------
# Go the File - Preferences - Solver, point the hops functions to the network sharepoint folder with GH_HopsFunctions (your repository) in it.
# Then you can right click a new hops component and select a .gh script from the folder.
# 
# This folder is maintained by devolopers, using git.
# 
# ALL hops in this file point to the public github url, which makes them shareable.
# 
# Symbols to be used when making userObject are name the same as the .gh file and placed in the same repository folder
# 
# Versioning and revision is controlled in the function files.
image_sampler = ImageSampler(Filter="Colour", Interpolate=True, Umax=842, Umin=1, Vmax=595, Vmin=1, Wrap=1)
copy_paste_to_hops_public_github_url_to = Panel("https://github.com/Slackking1/GH_HopsFunctions/raw/main/STATIK%20simpelt%20underst%C3%B8ttet%20bj%C3%A6lke%20med%20j%C3%A6vnt%20fordelt%20linjelast.gh")  # "COPY PASTE TO HOPS, public github URL to hooped up function"
last_i_kn_m = Slider(46, range=0..150)
bjælke_længde_i_meter = Slider(6.692, range=0..15)
skala_kurver = Slider(0.00233, range=0..0.01)
antal_beregnings_punkter = Slider(112, range=0..200)
public_github_url_to_hooped_up_function = Panel("https://github.com/Slackking1/GH_HopsFunctions/raw/main/STATIK%20simpelt%20underst%C3%B8ttet%20bj%C3%A6lke%20med%20j%C3%A6vnt%20fordelt%20linjelast.gh")
text_length = TextLength(Text=copy_paste_to_hops_public_github_url_to)
text_length_2 = TextLength(Text=public_github_url_to_hooped_up_function)
simpelt_understøttet_bjælke_jævn_last = SimpeltUnderstøttetBjælkeJævnLast(længde=bjælke_længde_i_meter, last=last_i_kn_m, antal_opdelinger=antal_beregnings_punkter, skaler_kurve=skala_kurver)  # -> unresolved_proxy, unresolved_proxy_2, unresolved_proxy_3, unresolved_proxy_4, unresolved_proxy_5, unresolved_proxy_6, unresolved_proxy_7, unresolved_proxy_8
text_fragment = TextFragment(Text=copy_paste_to_hops_public_github_url_to, Start=0, Count=expr("x-3", text_length))
text_fragment_2 = TextFragment(Text=public_github_url_to_hooped_up_function, Start=0, Count=expr("x-3", text_length_2))
længde = Længde()
last = Last()
antal_opdelinger = AntalOpdelinger()
skaler_kurve = SkalerKurve()
concatenate = Concatenate(FragmentA=text_fragment, FragmentB=".png")
concatenate_2 = Concatenate(FragmentA=text_fragment_2, FragmentB=".png")
simpelt_understøttet_bjælke_med_jævnt_fo = Hops(
    _Path=public_github_url_to_hooped_up_function,
    Længde=længde,
    Last=last,
    AntalOpdelinger=antal_opdelinger,
    SkalerKurve=skaler_kurve,
    CacheResultsInMemory=False,
    CacheSolveResults=False,
    RemoteDefinitionLocation="https://github.com/Slackking1/GH_HopsFunctions/raw/main/STATIK%20simpelt%20underst%C3%B8ttet%20bj%C3%A6lke%20med%20j%C3%A6vnt%20fordelt%20linjelast.gh",
    RemoteSolveVersion=(0, 1, 0),
    ShowInput_Enabled=False,
    ShowInput_Path=True,
    SynchronousSolve=True)  # -> Bjælke, Mmax, MX, Mkurve, Vkurve, ReaktionGrafik, LodretReaktion, Vmax; "Simpelt understøttet bjælke med jævnt fordelt last"
curve = Curve(simpelt_understøttet_bjælke_jævn_last.unresolved_proxy_6)
curve_2 = Curve(simpelt_understøttet_bjælke_jævn_last.unresolved_proxy_8)
curve_3 = Curve(simpelt_understøttet_bjælke_jævn_last.unresolved_proxy_4)
curve_4 = Curve(simpelt_understøttet_bjælke_jævn_last.unresolved_proxy)
panel = Panel(concatenate)
panel_2 = Panel(simpelt_understøttet_bjælke_jævn_last.unresolved_proxy_2)
panel_3 = Panel(simpelt_understøttet_bjælke_jævn_last.unresolved_proxy_5)
panel_4 = Panel(simpelt_understøttet_bjælke_jævn_last.unresolved_proxy_7)
panel_5 = Panel(concatenate_2)
hops = Hops(
    Længde=11.52,
    Last=50,
    AntalOpdelinger=128,
    SkalerKurve=0.002,
    CacheResultsInMemory=True,
    CacheSolveResults=True,
    RemoteDefinitionLocation="C:\Users\DBO\OC Engineering ApS\Ressourcer - Software and coding\Grasshopper og Rhino\GH_HopsFunctions\STATIK_SimplySupportedBeamWithUniformLoad.gh",
    RemoteSolveVersion=(0, 1, 0),
    ShowInput_Enabled=False,
    ShowInput_Path=False,
    SynchronousSolve=True)  # -> Bjælke, Mmax, MX, Mkurve, Vkurve, ReaktionGrafik, LodretReaktion, Vmax
panel_6 = Panel(simpelt_understøttet_bjælke_jævn_last.unresolved_proxy_3)
curve_5 = Curve(simpelt_understøttet_bjælke_med_jævnt_fo.ReaktionGrafik)
curve_6 = Curve(simpelt_understøttet_bjælke_med_jævnt_fo.Vmax)
curve_7 = Curve(simpelt_understøttet_bjælke_med_jævnt_fo.Mkurve)
curve_8 = Curve(simpelt_understøttet_bjælke_med_jævnt_fo.Bjælke)
panel_7 = Panel(simpelt_understøttet_bjælke_med_jævnt_fo.Mmax)
panel_8 = Panel(simpelt_understøttet_bjælke_med_jævnt_fo.Vkurve)
panel_9 = Panel(simpelt_understøttet_bjælke_med_jævnt_fo.LodretReaktion)
panel_10 = Panel(simpelt_understøttet_bjælke_med_jævnt_fo.MX)
mappe_med_hops_definationer = Panel("C:\Users\DBO\OC Engineering ApS\Ressourcer - Software and coding\Grasshopper og Rhino\GH_HopsFunctions\")
directory_contents = DirectoryContents(FolderPath=mappe_med_hops_definationer, Filter="*.gh", IncludeSubfolders=False)  # -> FilePaths, FileNames
item_selector = ItemSelector(
    directory_contents.FileNames,
    {"SHAPE_HyperbolicTowerWithColumns", "STATIK_SimplySupportedBeamWithUniformLoad"}, selected="SHAPE_HyperbolicTowerWithColumns")
concatenate_3 = Concatenate(Fragment_A=mappe_med_hops_definationer, Fragment_B=item_selector, A=".gh")

# ---- group: Edit hops definition
launch_application = LaunchApplication(LaunchToggle=Button(), ApplicationPath=concatenate_3)

# ----
hops_2 = Hops(
    _Path=concatenate_3,
    HeightM=39,
    RadiusTopM=17,
    RadiusBottomM=16,
    FoundationsAmount=17,
    RotationSectionsAmount=6,
    TopBeamRadiusM=0.19149,
    ColumnsRadiusM=0.19149,
    CacheResultsInMemory=True,
    CacheSolveResults=True,
    RemoteDefinitionLocation="C:\Users\DBO\OC Engineering ApS\Ressourcer - Software and coding\Grasshopper og Rhino\GH_HopsFunctions\SHAPE_HyperbolicTowerWithColumns.gh",
    RemoteSolveVersion=(0, 1, 0),
    ShowInput_Enabled=False,
    ShowInput_Path=True,
    SynchronousSolve=True)  # -> CenterlineTopBeam, CenterLinesColumns, TopBeam, Columns

# ==== cluster SimpeltUnderstøttetBjælkeJævnLast
antal_opdelinger = ClusterInput()
skaler_kurve = ClusterInput()
længde = ClusterInput()
last = ClusterInput()
unresolved_proxy = ClusterOutput(<missing>)
unresolved_proxy_2 = ClusterOutput(<missing>)
unresolved_proxy_3 = ClusterOutput(<missing>)
unresolved_proxy_4 = ClusterOutput(<missing>)
unresolved_proxy_5 = ClusterOutput(<missing>)
unresolved_proxy_6 = ClusterOutput(<missing>)
unresolved_proxy_7 = ClusterOutput(<missing>)
unresolved_proxy_8 = ClusterOutput(<missing>)
